# Grasshopper definition 3dbase.gh (Grasshopper 0.9.80)

point = Point(<point referenced from the Rhino model>)
point_2 = Point(<point referenced from the Rhino model>)
point_3 = Point(<point referenced from the Rhino model>)
point_4 = Point(<point referenced from the Rhino model>)
box_2pt = Box2Pt(PointA=point_3, PointB=point, Plane=PlaneXY(0, 0, 0))
box_2pt_2 = Box2Pt(PointA=point_4, PointB=point_2, Plane=PlaneXY(0, 0, 0))
