# Grasshopper definition Breezeblocks2.gh (Grasshopper 0.9.80)

square = Square(Plane=PlaneXY(0, 0, 0), Size=Slider(8, range=0..10), ExtentX=5, ExtentY=5)  # -> Cells, Points

plane = Plane(Plane(origin=(6, 6, 0), x=(-1, 0, 0), y=(0, -1, 0)))
plane_2 = Plane(Plane(origin=(34, 6, 0), x=(1, 0, 0), y=(0, -1, 0)))
plane_3 = Plane(Plane(origin=(6, 34, 0), x=(-1, 0, 0), y=(0, 1, 0)))
plane_4 = Plane(PlaneXY(34, 34, 0))
circle = Circle(Plane=plane_4, Radius=Slider(14, range=0..20))
circle_2 = Circle(Plane=plane_3, Radius=Slider(14, range=0..20))
circle_3 = Circle(Plane=plane_2, Radius=Slider(14, range=0..20))
circle_4 = Circle(Plane=plane, Radius=Slider(14, range=0..20))

plane_5 = Plane(Plane(origin=(6, 6, 0), x=(-1, 0, 0), y=(0, -1, 0)))
plane_6 = Plane(PlaneXY(34, 34, 0))
plane_7 = Plane(Plane(origin=(6, 34, 0), x=(-1, 0, 0), y=(0, 1, 0)))
plane_8 = Plane(Plane(origin=(34, 6, 0), x=(1, 0, 0), y=(0, -1, 0)))
circle_5 = Circle(Plane=plane_5, Radius=Slider(9, range=0..20))
circle_6 = Circle(Plane=plane_6, Radius=Slider(9, range=0..20))
circle_7 = Circle(Plane=plane_7, Radius=Slider(9, range=0..20))
circle_8 = Circle(Plane=plane_8, Radius=Slider(9, range=0..20))

plane_9 = Plane(PlaneXY(20, 21, 0))
square_2 = Square(Plane=PlaneXY(0, 0, 0), Size=Slider(8, range=0..10), ExtentX=5, ExtentY=5)  # -> Cells, Points
circle_9 = Circle(Plane=plane_9, Radius=Slider(15, range=0..20))
