# Grasshopper definition NewTest2*.gh (Grasshopper 0.9.80)

point = Point([Point(-50, 30, 0), Point(-69, -10, 0), Point(-47, -51, 0), Point(-30, -51, 0), Point(-56, -10, 0), Point(-36, 28, 0), Point(-50, 30, 0), Point(-50, 30, 0)])
polyline = PolyLine(Vertices=point, Closed=False)
control_knob = ControlKnob(Decimals=2, Limit=True, Maximum=10, Minimum=0, Range=1, Value=2.62)
control_knob_2 = ControlKnob(Decimals=2, Limit=True, Maximum=10, Minimum=0, Range=1, Value=1.72)
rectangle = Rectangle(Plane=PlaneXY(0, 0, 0), XSize=Slider(7.184, range=0..10), YSize=Slider(3.51, range=0..10), Radius=0)  # -> Rectangle, Length
rectangle_2 = Rectangle(Plane=PlaneXY(0, 0, 0), XSize=Slider(0.54, range=0..10), YSize=Slider(7.184, range=0..10), Radius=0)  # -> Rectangle, Length
rotate = Rotate(Geometry=rectangle.Rectangle, Angle=control_knob, Plane=PlaneXY(0, 0, 0))  # -> Geometry, Transform
rotate_2 = Rotate(Geometry=rectangle_2.Rectangle, Angle=control_knob_2, Plane=PlaneXY(0, 0, 0))  # -> Geometry, Transform
vector = Vector(Vector(-31, -45, 0))
vector_2 = Vector(Vector(-38, 20, 0))
move = Move(Geometry=rotate_2.Geometry, Motion=vector)  # -> Geometry, Transform
move_2 = Move(Geometry=rotate.Geometry, Motion=vector_2)  # -> Geometry, Transform
region_difference = RegionDifference(CurvesA=polyline, CurvesB=move_2.Geometry)
region_difference_2 = RegionDifference(CurvesA=region_difference, CurvesB=move.Geometry)

circle = Circle({Plane=Plane(origin=(0, 0, 0), x=(0.2659289981, -0.9639926182, 0), y=(0.9639926182, 0.2659289981, 0)), Radius=30.08321791})
circle_2 = Circle({Plane=Plane(origin=(0, 0, 0), x=(0.3559953276, -0.9344877349, 0), y=(0.9344877349, 0.3559953276, 0)), Radius=22.47220505})
vector_3 = Vector(Vector(0, -27, 0))
rectangle_3 = Rectangle(Plane=PlaneXY(0, 0, 0), XSize=Slider(3.5, range=0..5), YSize=Slider(7.184, range=0..10), Radius=0)  # -> Rectangle, Length
move_3 = Move(Geometry=rectangle_3.Rectangle, Motion=vector_3)  # -> Geometry, Transform
polar_array = PolarArray(Geometry=move_3.Geometry, Plane=PlaneXY(0, 0, 0), Count=10, Angle=6.283185307)  # -> Geometry, Transform
region_difference_3 = RegionDifference(CurvesA=polar_array.Geometry, CurvesB=circle_2)

circle_3 = Circle({Plane=Plane(origin=(0, 0, 0), x=(0.6936416871, -0.7203202135, 0), y=(0.7203202135, 0.6936416871, 0)), Radius=37.48332963})
circle_4 = Circle({Plane=Plane(origin=(0, 0, 0), x=(0.4603171645, -0.8877545314, 0), y=(0.8877545314, 0.4603171645, 0)), Radius=30.41381265})
vector_4 = Vector(Vector(0, -35, 0))
rectangle_4 = Rectangle(Plane=PlaneXY(0, 0, 0), XSize=Slider(3.5, range=0..5), YSize=Slider(7.137, range=0..10), Radius=0)  # -> Rectangle, Length
move_4 = Move(Geometry=rectangle_4.Rectangle, Motion=vector_4)  # -> Geometry, Transform
polar_array_2 = PolarArray(Geometry=move_4.Geometry, Plane=PlaneXY(0, 0, 0), Count=10, Angle=6.283185307)  # -> Geometry, Transform
region_difference_4 = RegionDifference(CurvesA=polar_array_2.Geometry, CurvesB=circle_4)
